# Grasshopper definition SpacePartition.gh (Grasshopper 1.0.7)
# plug-ins: FloorsAndVolumes, PTComponentLibrary

number_slider = Slider(6, range=0..10)
number_slider_2 = Slider(3, range=0..5)
dom = ConstructDomain(DomainStart=expr("-x", Slider(0, range=0..100)), DomainEnd=Slider(1, range=0..1))
number_slider_3 = Slider(5, range=0..10)
dom_2 = ConstructDomain(DomainStart=expr("-x", number_slider), DomainEnd=number_slider)
dom_3 = ConstructDomain(DomainStart=expr("-x", number_slider_2), DomainEnd=number_slider_2)
genemodifier = GenePoolModifier(GeneList="SeedsX", Count=number_slider_3, Domain=dom)
genemodifier_2 = GenePoolModifier(GeneList="SeedsY", Count=number_slider_3, Domain=dom)
rectangle = Rectangle(Plane=PlaneXY(0, 0, 0), XSize=dom_3, YSize=dom_2, Radius=0)  # -> Rectangle, Length
seedsy = GenePool(Decimals=2, Maximum=1, Minimum=0, Value=[0.04075478252, 0.6846103569, 0.7226756782, 0.3567348529, 0.2312103339])
seedsx = GenePool(Decimals=2, Maximum=1, Minimum=0, Value=[0.1040402554, 0.24, 0.1926518721, 0.79, 0.96])
crv = Curve(rectangle.Rectangle)
pt = ConstructPoint(XCoordinate=seedsx, YCoordinate=seedsy, ZCoordinate=0)
ptsrfdomlen = SurfaceDomainLength(Surface=crv, ULength=Slider(2, range=0..5), VLength=Slider(3, range=0..5))
evalsrf = EvaluateSurface(Surface=reparameterize(crv), Point=pt)  # -> Point, Normal, UDirection, VDirection, Frame
pt_2 = Point(evalsrf.Point)
ptborders = GenerateBorders(Grid=ptsrfdomlen, PanelShape=0)  # -> simplify(Border)
voronoi = Voronoi(Points=pt_2, Boundary=crv, BruteForceOverride=False)
pdecon = Deconstruct(Point=pt_2)  # -> XComponent, YComponent, ZComponent
crv_2 = Curve(flatten(ptborders))
sort = SortList(Keys=pdecon.YComponent, ValuesA=voronoi)  # -> Keys, ValuesA
area = Area(Geometry=crv_2, UseTasks=False)  # -> Area, Centroid
c_script = CSharpScript(x=sort.ValuesA, y=crv_2)  # -> A, B, C; inputs x: list of Polyline, y: list of Polyline
# ---------- c_script: C# usings ----------
using System.Linq;
# ---------- c_script: C# ----------
    var intersections = new DataTree<Curve>();
    var areas = new DataTree<double>();
    var repeated = new DataTree<Polyline>();

    for( int i = 0; i < x.Count; ++i )
    {

      repeated.AddRange(y, new GH_Path(i));

      for( int j = 0; j < y.Count; ++j )
      {

        intersections.AddRange(Curve.CreateBooleanIntersection(x[i].ToNurbsCurve(), y[j].ToNurbsCurve(), 1e-7).ToList(), new GH_Path(i, j));

      }

    }

    for( int i = 0; i < intersections.BranchCount; ++i )
    {

      var tempList = intersections.Branch(i);
      var path = intersections.Path(i);

      if( tempList.Count > 0 )
      {

        areas.Add(AreaMassProperties.Compute(intersections.Branch(i)[0]).Area, path);

      }

      else
      {

        areas.Add(-1000, path);

      }

    }

    A = areas;
    B = intersections;
    C = repeated;
# ---------- end c_script ----------
path_mapper = PathMapper(c_script.A, source="{A;B}", target="{A}")
multiplication = Multiplication(A=area.Area, B=0.5)
expression = Expression(x=path_mapper, y=multiplication, Expression="If( x < ( y - ( y * 0.2 ) ), False, True )")
cull = CullPattern(List=c_script.C, CullPattern=expression)
srf = Surface(cull)
panel = Panel(srf)
bang = ExplodeTree(Data=srf)  # -> Branch0, Branch1, Branch2, Branch3, Branch4
srf_2 = Surface(bang.Branch2)
srf_3 = Surface(bang.Branch0)
srf_4 = Surface(bang.Branch1)
srf_5 = Surface(bang.Branch3)
srf_6 = Surface(bang.Branch4)
number_slider_4 = Slider(1, range=0..1)
number_slider_5 = Slider(1, range=0..1)
number_slider_6 = Slider(0, range=0..1)
frgb = ColourRGBF(Alpha=1, Red=Slider(1, range=0..1), Green=0, Blue=0)
frgb_2 = ColourRGBF(Alpha=1, Red=number_slider_4, Green=number_slider_4, Blue=0)
frgb_3 = ColourRGBF(Alpha=1, Red=number_slider_5, Green=number_slider_5, Blue=number_slider_5)
frgb_4 = ColourRGBF(Alpha=1, Red=number_slider_6, Green=number_slider_6, Blue=number_slider_6)
frgb_5 = ColourRGBF(Alpha=1, Red=Slider(0, range=0..1), Green=Slider(0, range=0..1), Blue=Slider(1, range=0..1))
preview = CustomPreview(Geometry=srf_3, Material=frgb)
preview_2 = CustomPreview(Geometry=srf_4, Material=frgb_2)
preview_3 = CustomPreview(Geometry=srf_2, Material=frgb_3)
preview_4 = CustomPreview(Geometry=srf_5, Material=frgb_4)
preview_5 = CustomPreview(Geometry=srf_6, Material=frgb_5)
